# Grasshopper definition voxelate.gh (Grasshopper 1.0.7)

panel = Panel("C:\BACKUP\Playdata\202105_lab\02.git\fff\voxelate\79andPARK.3dm")
md_slider = MDSlider(
    SliderMode=0,
    slider_value=Point(0.353287834, 0.1904332008, 0.5),
    x_domain=Domain(0, 1),
    y_domain=Domain(0.5, 1),
    z_domain=Domain(0, 1))
import_3dm = Import3DM(File="C:\BACKUP\Playdata\202105_lab\02.git\fff\voxelate\RED7.3dm", Layer="*", Name="*")
import_3dm_2 = Import3DM(File=panel, Layer="*", Name="*")
import_3dm_3 = Import3DM(File="Load your model!", Layer="*", Name="*")
brep = Brep(import_3dm)
brep_2 = Brep(import_3dm_2)
brep_3 = Brep(import_3dm_3)
colour_swatch = ColourSwatch(SwatchColor=RGB(255, 255, 255))
ghpython_script = GhPythonScript(brep=brep_2, sun_position=md_slider)  # -> out, brep, voxels, environment, angles, a, b, c, other_voxels; inputs brep: Brep, sun_position: list
# ---------- ghpython_script: Python ----------
"""need to cleanup code"""
import math
import Rhino.Geometry as rg
import ghpythonlib.components as gh
import ghpythonlib.treehelpers as gt


TOLERANCE = 0.001
HEMISPHERE_RAD = 100
SUN_RAD = 5
MOVE_DIST = 150


class Environment:
    def __init__(self, brep, sun_position):
        self.brep = brep
        self.sun_position = sun_position
        self.__generate()
        
    def __generate(self):
        self.__gen_environment_bbox()
        self.__gen_hemisphere()
        self.__gen_sun()
        self.__gen_sun_facing_plane()
        
    def __gen_environment_bbox(self):
        self.environment_bbox = self.brep.GetBoundingBox(rg.Plane.WorldXY)
        self.environment_bbox_faces, _, _ = gh.DeconstructBrep(self.environment_bbox)
        self.environment_bbox_bottom_face = sorted(self.environment_bbox_faces, key=lambda f: gh.Area(geometry=f).centroid.Z)[0]
        _, self.environment_bbox_bottom_face_centroid = gh.Area(self.environment_bbox_bottom_face)
        self.environment_bbox_bottom_face_scaling, _ = gh.Scale(
            geometry=self.environment_bbox_bottom_face,
            center=self.environment_bbox_bottom_face_centroid,
            factor=10,
        )
        
    def __gen_hemisphere(self):
        self.sphere = gh.Sphere(
            base=self.environment_bbox_bottom_face_centroid,
            radius=HEMISPHERE_RAD,
        )
        _, self.hemisphere = self.sphere.Split(self.environment_bbox_bottom_face_scaling, TOLERANCE)
        self.interval = rg.Interval(0, 1)
        self.hemisphere.Faces[0].SetDomain(0, self.interval)
        self.hemisphere.Faces[0].SetDomain(1, self.interval)
        
    def __gen_sun(self):
        self.sun_point = self.hemisphere.Faces[0].Evaluate(
            u=self.sun_position[0][0], 
            v=self.sun_position[0][1], 
            numberDerivatives=0,
        )[1]
        
        self.sun = gh.Sphere(base=self.sun_point, radius=SUN_RAD)
        
    def __gen_sun_facing_plane(self):
        self.sun_point_to_face_centroid = rg.Line(self.sun_point, self.environment_bbox_bottom_face_centroid)
        self.projected_sun_point_to_face_centroid = gh.Project(
            curve=self.sun_point_to_face_centroid,
            brep=self.environment_bbox_bottom_face_scaling,
            direction=rg.Point3d(0, 0, 1)
        )
        
        self.plane = (
            rg.Plane.WorldXY if self.projected_sun_point_to_face_centroid is None 
            else gh.HorizontalFrame(self.projected_sun_point_to_face_centroid, 0.5)
        )


class Voxel:
    def __init__(
        self, 
        voxel_geom=None,
        voxel_geom_centroid=None,
        facing_angle=None,
        is_roof=False,
        is_exterior=False,
        is_sun_facing=False,
    ):
        self.voxel_geom = voxel_geom
        self.voxel_geom_centroid = voxel_geom_centroid
        self.facing_angle = facing_angle
        self.is_roof = is_roof
        self.is_exterior = is_exterior
        self.is_sun_facing = is_sun_facing
        
    def get_voxel_information(self, voxel_geom, sun_centroid, remain_voxels_centroids):
        voxel_geom_centroid = gh.Volume(voxel_geom).centroid
        
        facing_angle = self.__get_facing_angle(voxel_geom_centroid, sun_centroid)
        is_roof, is_exterior, is_sun_facing = self.__get_voxel_statement(voxel_geom, remain_voxels_centroids)
        
        return Voxel(
            voxel_geom=voxel_geom,
            voxel_geom_centroid=voxel_geom_centroid,
            facing_angle=facing_angle,
            is_roof=is_roof,
            is_exterior=is_exterior,
            is_sun_facing=False,
        )
        
    def __get_facing_angle(self, voxel_geom_centroid, sun_centroid):
        x1, y1, _ = voxel_geom_centroid
        x2, y2, _ = sun_centroid
        return math.atan2(y2 - y1, x2 - x1)
        
    def __get_voxel_statement(self, voxel_geom, remain_voxels_centroids):
        def __is_close(n1, n2, tolerance=TOLERANCE):
            return abs(n1 - n2) <= tolerance
        
        voxel_geom_faces_centroids, _ = gh.FaceNormals(voxel_geom)
        remain_voxels_centroids_cloud = rg.PointCloud(remain_voxels_centroids)
        
        c = 0
        is_roof = False
        is_exterior = False
        is_sun_facing = False
        
        for fci, face_centroid in enumerate(voxel_geom_faces_centroids[1:]):
            closest_point_idx = remain_voxels_centroids_cloud.ClosestPoint(face_centroid)
            statement_checker = __is_close(
                remain_voxels_centroids[closest_point_idx].DistanceTo(face_centroid), 
                self.voxel_size / 2
            )
            
            if fci == 0:
                is_roof = not statement_checker
                
            elif fci in (1, 2, 3, 4) and statement_checker:
                c += 1
                
        is_exterior = c != 4 and not is_roof
        
        return is_roof, is_exterior, False
        
    def __get_voxel_statement_without_geom(self, voxel_geom, voxel_3d_list):
        return


class VoxelShape(Voxel, Environment):
    def __init__(self, brep, voxel_size, sun_position):
        self.brep = brep
        self.voxel_size = voxel_size
        self.sun_position = sun_position
        self.__voxelate()
        
    def __len__(self):
        return len(self.voxels)
        
    def __getitem__(self, i):
        return self.voxels[i]
        
    def __voxelate(self):
        self.__gen_moved_brep()
        self.__gen_environment()
        self.__gen_moved_brep_bbox()
        self.__gen_grid()
        self.__gen_voxels()
        
    def __gen_moved_brep(self):
        self.moved_brep, _ = gh.Move(geometry=self.brep, motion=rg.Point3d(MOVE_DIST, 0, 0))
        self.moved_brep_mesh = rg.Mesh.CreateFromBrep(self.moved_brep, rg.MeshingParameters(0))
        
    def __gen_environment(self):
        Environment.__init__(self, self.moved_brep, sun_position)
        Voxel.__init__(self)
        
    def __gen_moved_brep_bbox(self):
        self.moved_brep_bbox, _ = gh.BoundingBox(content=self.moved_brep, plane=self.plane)
        self.moved_brep_bbox_faces, _, _ = gh.DeconstructBrep(brep=self.moved_brep_bbox)
        self.moved_brep_bbox_bottom_face = sorted(self.moved_brep_bbox_faces, key=lambda f: gh.Area(geometry=f).centroid.Z)[0]
        
    def __gen_grid(self):
        moved_brep_bbox_bottom_face_segments, _ = gh.Explode(curve=self.moved_brep_bbox_bottom_face, recursive=True)
        
        seg_1, seg_2, _, _ = moved_brep_bbox_bottom_face_segments
        seg_1_vector = seg_1.Line.PointAtLength(self.voxel_size) - seg_1.Line.PointAt(0)
        seg_2_vector = seg_2.Line.PointAtLength(self.voxel_size) - seg_2.Line.PointAt(0)
        
        grid_origin = gh.HorizontalFrame(curve=seg_1, parameter=0)
        base_rectangle, _ = gh.Rectangle(plane=grid_origin, x_size=self.voxel_size, y_size=self.voxel_size, radius=0)
        
        self.x_cols = int(seg_1.Line.Length // self.voxel_size) + 2
        self.y_cols = int(seg_2.Line.Length // self.voxel_size) + 2
        self.z_cols = int(self.moved_brep_bbox.Z[1] // self.voxel_size) + 2
        
        x_grid = []
        for x in range(self.x_cols):
            motion = seg_1_vector * x
            moved_rectangle, _ = gh.Move(geometry=base_rectangle, motion=motion)
            x_grid.append(moved_rectangle)
        
        base_grid = []
        for y in range(self.y_cols):
            motion = seg_2_vector * y
            moved_rectangles, _ = gh.Move(geometry=x_grid, motion=motion)
            base_grid.extend(moved_rectangles)
        
        self.grid = []
        for z in range(self.z_cols):
            motion = rg.Point3d(0, 0, z * self.voxel_size)
            moved_rectangles, _ = gh.Move(geometry=base_grid, motion=motion)
            self.grid.extend(moved_rectangles)
            
    def __gen_voxels(self):
        self.grid_centroid = [g.Center for g in self.grid]
        self.inside_grid_centroid = gh.MeshInclusion(
            mesh=gh.MeshJoin(self.moved_brep_mesh), 
            point=self.grid_centroid, 
            strict=False
        )
        
        self.inside_grid_centroid_integer = [
            int(b) for b in self.inside_grid_centroid
        ]
        
        self.voxel_3d_list = self.__get_reshaped_list(
            self.inside_grid_centroid_integer, self.x_cols, self.y_cols, self.z_cols
        )
        
        self.inside_grid = [
             self.grid[ci] for ci, p in enumerate(self.inside_grid_centroid) if p
        ]
        
        self.voxels_centroids = [
            g.Center + rg.Point3d(0, 0, self.voxel_size / 2) for g in self.inside_grid
        ]
        
        _, sun_centroid = gh.Volume(self.sun)
        
        self.voxels = [
            rg.Mesh.CreateFromBox(v, 1, 1, 1) for v in  gh.BoxRectangle(self.inside_grid, self.voxel_size)
        ]
        
#        print(self.voxel_3d_list[1])
#        self.__get_voxel_statement_without_geom(self.voxel_3d_list)
        
        roof_list = self.__get_reshaped_list([0] * len(self.grid_centroid), self.x_cols, self.y_cols, self.z_cols)
        exterior_list = self.__get_reshaped_list([0] * len(self.grid_centroid), self.x_cols, self.y_cols, self.z_cols)
        for zi, z_list in enumerate(self.voxel_3d_list):
            next_zi = (zi + 1) % len(self.voxel_3d_list)
            
            for yi, y_list in enumerate(z_list):
                prev_yi = (yi - 1) % len(z_list)
                next_yi = (yi + 1) % len(z_list)
                
                for xi, x in enumerate(y_list):
                    
                    prev_x = y_list[(xi - 1) % len(y_list)]
                    next_x = y_list[(xi + 1) % len(y_list)]
                    back_x = z_list[prev_yi][xi]
                    frnt_x = z_list[next_yi][xi]
                    
                    is_roof = bool(x) and not bool(self.voxel_3d_list[next_zi][yi][xi])
                    is_exterior = bool(x) and any([not prev_x , not next_x, not back_x, not frnt_x])
                    
                    if is_roof:
                        roof_list[zi][yi][xi] = 1
                    
                    elif is_exterior and not is_roof:
                        exterior_list[zi][yi][xi] = 1
        
        print(exterior_list[1])
#        self.voxels_objects = []
#        for vi, voxel_geom in enumerate(self.voxels):
#            remain_voxels_centroids = self.voxels_centroids[:vi] + self.voxels_centroids[vi+1:]
#            voxel_object = self.get_voxel_information(voxel_geom, sun_centroid, remain_voxels_centroids)
#            
#            self.voxels_objects.append(voxel_object)
        
    def __get_reshaped_list(self, one_dim_list, x_shape, y_shape, z_shape):
        x_divided_list = [
            one_dim_list[x : x + x_shape] for x in range(0, len(one_dim_list), x_shape)
        ]
        
        y_divided_list = [
            x_divided_list[y : y + y_shape] for y in range(0, len(x_divided_list), y_shape)
        ]
        
        z_divided_list = [
            y_divided_list[z : z + z_shape] for z in range(0, len(y_divided_list), z_shape)
        ]
        
        return z_divided_list[0]



if __name__ == "__main__":
    voxel_shape = VoxelShape(
        brep=brep, 
        voxel_size=3, 
        sun_position=sun_position
    )
    
    c = voxel_shape.voxels
    
#    voxels = [v.voxel_geom for v in voxel_shape.voxels_objects]
#    angles = [v.facing_angle for v in voxel_shape.voxels_objects]
#    environment = voxel_shape.hemisphere, voxel_shape.sun

    a = gt.list_to_tree(voxel_shape.voxel_3d_list)
    other_voxels = voxel_shape.grid_centroid
# ---------- end ghpython_script ----------
bounds = Bounds(Numbers=ghpython_script.angles)  # disabled
deconstruct_domain = DeconstructDomain(Domain=bounds)  # -> Start, End; disabled
geometry = Geometry(ghpython_script.other_voxels)
list_item = ListItem(List=geometry, Index=1, Wrap=True)
custom_preview = CustomPreview(Geometry=ghpython_script.brep, Material=colour_swatch)
custom_preview_2 = CustomPreview(Geometry=ghpython_script.voxels, Material=colour_swatch)
custom_preview_3 = CustomPreview(Geometry=ghpython_script.environment, Material=ColourSwatch(SwatchColor=RGBA(255, 255, 255, 17)))
geometry_2 = Geometry(ghpython_script.c)
gradient = Gradient(
    LowerLimit=deconstruct_domain.Start,
    UpperLimit=deconstruct_domain.End,
    Parameter=ghpython_script.angles,
    stops=[0.149: RGB(255, 255, 0), 0.494: RGB(255, 0, 0), 0.852: RGB(255, 255, 0)])  # disabled
geometry_3 = Geometry(ghpython_script.b)
geometry_4 = Geometry(flatten(geometry_3))
data = Data(flatten(ghpython_script.a))
tree_item = TreeItem(Tree=geometry_3, Path="0;11;32", Index=0, Wrap=True)
custom_preview_4 = CustomPreview(Geometry=ghpython_script.voxels, Material=gradient)  # disabled
panel_2 = Panel(geometry_3)
sphere = Sphere(Base=tree_item, Radius=1)
custom_preview_5 = CustomPreview(
    Geometry=sphere,
    Material={diffuse=RGB(221, 160, 221), emission=RGB(66, 48, 66), shine=0.5, specular=RGB(255, 255, 255), transparency=0})
panel_3 = Panel(data)
panel_4 = Panel(ghpython_script.out)
cull_pattern = CullPattern(List=panel_3, CullPattern=panel_3)  # disabled
cull_pattern_2 = CullPattern(List=panel_2, CullPattern=panel_3)  # disabled
text_tag_3d = TextTag3D(Location=geometry_3, Text=panel_3, Size=1, Justification=5)  # disabled
colour_swatch_2 = ColourSwatch(SwatchColor=RGB(255, 255, 255))  # disabled
text_tag_3d_2 = TextTag3D(Location=cull_pattern_2, Text=cull_pattern, Size=1.3, Colour=colour_swatch_2, Justification=5)  # disabled
